# Grasshopper definition CP2 - Final 2.gh (Grasshopper 1.0.7)
# plug-ins: MarchingCubes, Weaverbird

gene_pool = GenePool(Decimals=2, Maximum=100, Minimum=0, Value=[50, 55.5, 98.57, 51.43])
P = Point([Point(-29.15247137, -58.51783965, 15.85347772), Point(-71.29677478, 21.56685656, 0), Point(11.57669672, 31.37082205, 23.54553147), Point(29.16879227, -39.7527152, 6.432456863)])
point_charge = PointCharge(Point=P, Radius=gene_pool, ChargeStrength=Slider(1, range=0..1))
cocoon = Cocoon(
    Charges=point_charge,
    Iso=Slider(0.34, range=0..1),
    CellSize=Slider(16, range=0..100),
    Execute=Toggle(True),
    Simple=False)  # -> Mesh, RefinementData
number_slider = Slider(16, range=0..100)
refine = Refine(
    RefinementData=cocoon.RefinementData,
    Samples=number_slider,
    SampleSize=Slider(6.1, range=0..10),
    SampleTolerance=Slider(0.01, range=0..0.01),
    LaplacianSmoothing=number_slider,
    ValencePasses=number_slider,
    SubD=Slider(3, range=0..100),
    Execute=Toggle(True))
mesh = Mesh(refine)
wbframe = WeaverbirdsPictureFrame(MeshPolylines=mesh, Distance=Slider(9, range=0..100), InsetType=0)
wbcatmullclark = WeaverbirdsCatmullClarkSubdivision(MeshCurves=wbframe, Level=Slider(5, range=0..10), SmoothNakedEdges=1)
wbthicken = WeaverbirdsMeshThicken(MeshCurves=wbcatmullclark, Distance=Slider(2, range=0..10), OffsetType=0)
wbcatmullclark_2 = WeaverbirdsCatmullClarkSubdivision(Level=1, SmoothNakedEdges=1)
