# Grasshopper definition Grasshopper - 4 balls.gh (Grasshopper 1.0.7)
# plug-ins: MarchingCubes

genes = GenePool(Decimals=2, Maximum=500, Minimum=10, Value=[279.5, 500, 361.4388889, 335.7955556])
P = Point([Point(434.6601785, 315.2843572, -8.247945287), Point(6.679678545, 31.76295698, 101.7748208), Point(-51.93259418, -374.4047249, -230.5024811), Point(687.4152182, -35.22005241, -211.5871373)])
B = Brep(<brep referenced from the Rhino model>)
C = Curve(<curve referenced from the Rhino model>)
brep_charge = BrepCharge(Brep=B, Radius=Slider(12.5, range=0..100), ChargeStrengths=Slider(1, range=0..1))
point_charge = PointCharge(Point=P, Radius=genes, ChargeStrength=Slider(1, range=0..1))
curve_charge = CurveCharge(Curve=C, Radius=Slider(33.4, range=0..100), ChargeStrengths=Slider(1, range=0..1))
number_slider = Slider(15, range=0..100)
cocoon = Cocoon(
    Charges=[point_charge, curve_charge],
    Iso=Slider(0.09, range=0..1),
    CellSize=Slider(16.6, range=2..100),
    Execute=Toggle(True),
    Simple=False)  # -> Mesh, RefinementData
msmooth = SmoothMesh(Mesh=cocoon.Mesh, Strength=Slider(0, range=0..1), SkipNaked=True, Iterations=1)
refine = Refine(
    Samples=number_slider,
    SampleSize=Slider(5.5, range=0..10),
    SampleTolerance=Slider(0.01, range=0..0.01),
    LaplacianSmoothing=number_slider,
    ValencePasses=number_slider,
    SubD=Slider(100, range=0..100),
    Execute=Toggle(True))
mesh = Mesh(<mesh referenced from the Rhino model>)
mesh_2 = Mesh(msmooth)
msplit = MeshSplit(Splitters=mesh)
