# Grasshopper definition Grasshopper - perforate organic frame.gh (Grasshopper 1.0.7)
# plug-ins: MarchingCubes, Weaverbird

genes = GenePool(Decimals=2, Maximum=500, Minimum=10, Value=[279.5, 500, 361.4388889, 335.7955556])
P = Point([Point(434.6601785, 315.2843572, -8.247945287), Point(6.679678545, 31.76295698, 101.7748208), Point(-51.93259418, -374.4047249, -230.5024811), Point(687.4152182, -35.22005241, -211.5871373)])
P_2 = Points([Point(258.3346794, -2642.433085, -132.3642901), Point(452.6157781, -2982.425008, 0), Point(724.6093163, -2817.286074, 0), Point(617.754712, -2564.720646, 0), Point(510.9001077, -2749.28769, 106.2368754), Point(439.4684867, -2587.688722, -104.9481631), Point(338.5106033, -2672.191121, 0), Point(485.0986064, -2857.019473, 142.4384419), Point(376.7509519, -2506.482944, 0), Point(262.0299059, -2579.882566, 0)])
pl = Plane(PlaneXY(0, 0, 0))
B = Brep(<brep referenced from the Rhino model>)
C = Curve(<curve referenced from the Rhino model>)
del = DelaunayMesh(Points=P_2, Plane=pl)
brep_charge = BrepCharge(Brep=B, Radius=Slider(12.5, range=0..100), ChargeStrengths=Slider(1, range=0..1))
point_charge = PointCharge(Point=P, Radius=genes, ChargeStrength=Slider(1, range=0..1))
curve_charge = CurveCharge(Curve=C, Radius=Slider(33.4, range=0..100), ChargeStrengths=Slider(1, range=0..1))
wbframe = WeaverbirdsPictureFrame(MeshPolylines=del, Distance=Slider(6.1, range=0.1..6.1), InsetType=0)
wbwindow = WeaverbirdsMeshWindow(MeshPolylines=del, Distance=Slider(10, range=0.1..10), InsetType=1)
number_slider = Slider(15, range=0..100)
cocoon = Cocoon(
    Charges=[point_charge, curve_charge],
    Iso=Slider(0.09, range=0..1),
    CellSize=Slider(16.6, range=2..100),
    Execute=Toggle(True),
    Simple=False)  # -> Mesh, RefinementData
wbthicken = WeaverbirdsMeshThicken(MeshCurves=wbframe, Distance=Slider(10, range=0..10), OffsetType=0)
wbthicken_2 = WeaverbirdsMeshThicken(MeshCurves=wbwindow, Distance=Slider(6.7, range=0.1..10), OffsetType=0)
wbcatmullclark = WeaverbirdsCatmullClarkSubdivision(MeshCurves=wbframe, Level=Slider(3, range=0..10), SmoothNakedEdges=1)
msmooth = SmoothMesh(Mesh=cocoon.Mesh, Strength=Slider(0, range=0..1), SkipNaked=True, Iterations=1)
refine = Refine(
    Samples=number_slider,
    SampleSize=Slider(5.5, range=0..10),
    SampleTolerance=Slider(0.01, range=0..0.01),
    LaplacianSmoothing=number_slider,
    ValencePasses=number_slider,
    SubD=Slider(100, range=0..100),
    Execute=Toggle(True))
wbcatmullclark_2 = WeaverbirdsCatmullClarkSubdivision(MeshCurves=wbthicken_2, Level=Slider(3, range=0.1..10), SmoothNakedEdges=1)
mesh = Mesh(<mesh referenced from the Rhino model>)
mesh_2 = Mesh(msmooth)
msplit = MeshSplit(Splitters=mesh)
wbthicken_3 = WeaverbirdsMeshThicken(MeshCurves=wbcatmullclark, Distance=Slider(11.2, range=0.1..20), OffsetType=0)
preview = CustomPreview(Geometry=wbcatmullclark, Material=ColourSwatch(SwatchColor=RGB(207, 76, 76)))
